# Dynamo custom node DWG.PolyLine.ByLayerGetCoordinates.dyf (Dynamo 2.6.1.8786)
# category: N3XT
# Get coordinates of polylines by layer

DWGInstance = Input(DWGInstance: var[]..[])
LayerName = Input(LayerName: var[]..[])
polyLineByLayer = Python(IN[0]=DWGInstance, IN[1]=LayerName)  # "CAD.PolyLineByLayer"
# ---------- polyLineByLayer.python (40 lines) ----------
import clr
clr.AddReference("RevitAPI")
import Autodesk
from Autodesk.Revit.DB.Events import *
from Autodesk.Revit.DB import *
from math import *

clr.AddReference('ProtoGeometry')
from Autodesk.DesignScript.Geometry import *

clr.AddReference("RevitNodes")
import Revit
clr.ImportExtensions(Revit.Elements)
clr.ImportExtensions(Revit.GeometryConversion)

clr.AddReference("RevitServices")
import RevitServices
from RevitServices.Persistence import DocumentManager
from RevitServices.Transactions import TransactionManager
#############################################################
doc = DocumentManager.Instance.CurrentDBDocument

dwg = UnwrapElement(IN[0])
keyword = IN[1]
polylst = []
dwgInstance = []


TransactionManager.Instance.EnsureInTransaction(doc)
for geometryObj in dwg.get_Geometry(Options()):
	dwgInstance.append(geometryObj)
	for dwg in dwgInstance:
		polyObject = dwg.SymbolGeometry
		for poly in polyObject:			
			if poly.GetType() == Autodesk.Revit.DB.PolyLine and doc.GetElement(poly.GraphicsStyleId).GraphicsStyleCategory.Name.find(keyword) != -1:		
				polylst.append(poly)

TransactionManager.Instance.TransactionTaskDone()

OUT =  polylst
# ----------------------------------------
filterPolyLine = Python(IN[0]=polyLineByLayer)  # "CADPolyLine.FilterPolyLine"
# ---------- filterPolyLine.python (35 lines) ----------
import clr

clr.AddReference('RevitAPI')
from Autodesk.Revit.DB import *

clr.AddReference('ProtoGeometry')
from Autodesk.DesignScript.Geometry import *



clr.AddReference('RevitNodes')
import Revit
clr.ImportExtensions(Revit.Elements)
clr.ImportExtensions(Revit.GeometryConversion)

clr.AddReference('RevitServices')
import RevitServices
from RevitServices.Persistence import DocumentManager
from RevitServices.Transactions import TransactionManager


doc = DocumentManager.Instance.CurrentDBDocument


items = IN[0]

output = []

TransactionManager.Instance.EnsureInTransaction(doc)
for item in items:
	if hasattr(item, "NumberOfCoordinates"):
		output.append(item)
TransactionManager.Instance.TransactionTaskDone()

OUT = output
# ----------------------------------------
coordinates = Python(IN[0]=filterPolyLine)  # "CADPolyLine.Coordinates"
# ---------- coordinates.python (45 lines) ----------
import clr

clr.AddReference('RevitAPI')
from Autodesk.Revit.DB import *

clr.AddReference('ProtoGeometry')
from Autodesk.DesignScript.Geometry import *



clr.AddReference('RevitNodes')
import Revit
clr.ImportExtensions(Revit.Elements)
clr.ImportExtensions(Revit.GeometryConversion)

clr.AddReference('RevitServices')
import RevitServices
from RevitServices.Persistence import DocumentManager
from RevitServices.Transactions import TransactionManager


doc = DocumentManager.Instance.CurrentDBDocument


items = IN[0]
lst1 = []
lst2 = []
pointlst = []


TransactionManager.Instance.EnsureInTransaction(doc)
for item in items:
	xyzpnt = item.GetCoordinates()
	lst1.append(xyzpnt)
for lst2 in lst1:
	pntlst = []
	if len(lst2) == 5 :
		for pnt in lst2:
			p = pnt.ToPoint()
			pntlst.append(p)
	pointlst.append(pntlst)

TransactionManager.Instance.TransactionTaskDone()

OUT = pointlst
# ----------------------------------------
getDWGInstanceOrigin = Python(IN[0]=DWGInstance)
# ---------- getDWGInstanceOrigin.python (34 lines) ----------
import clr
clr.AddReference("RevitAPI")
import Autodesk
from Autodesk.Revit.DB.Events import *
from Autodesk.Revit.DB import *
from math import *

clr.AddReference('ProtoGeometry')
from Autodesk.DesignScript.Geometry import *

clr.AddReference("RevitNodes")
import Revit
clr.ImportExtensions(Revit.Elements)
clr.ImportExtensions(Revit.GeometryConversion)

clr.AddReference("RevitServices")
import RevitServices
from RevitServices.Persistence import DocumentManager
from RevitServices.Transactions import TransactionManager
##############################################################
doc = DocumentManager.Instance.CurrentDBDocument

dwg = UnwrapElement(IN[0])
output = []

TransactionManager.Instance.EnsureInTransaction(doc)
for geometryObj in dwg.get_Geometry(Options()):
	trans = geometryObj.Transform
	o = trans.Origin
	ori = o.ToPoint()
	output.append(ori)
TransactionManager.Instance.TransactionTaskDone()

OUT =  output
# ----------------------------------------
X = Point.X(point=getDWGInstanceOrigin)
Y = Point.Y(point=getDWGInstanceOrigin)
Z = Point.Z(point=getDWGInstanceOrigin)
translate = Geometry.Translate(geometry=coordinates, xTranslation=X, yTranslation=Y, zTranslation=Z, lacing=Longest)
TranslatedCoordinates = Output(translate)
