# Dynamo graph Template.dyn (Dynamo 2.3.0.5885)

# group: Select Model Elements
boolean = BoolSelector(false)  # frozen
select_model_elements = Python(IN[0]=boolean)  # frozen
# ---------- select_model_elements.python (42 lines) ----------
import sys
import clr
#Cho Phép truy cập đến các đối tượng, view, sheet, element.... trong view hiện hành và chỉnh sửa được nó:
clr.AddReference('RevitServices')
import RevitServices
from RevitServices.Persistence import DocumentManager
from RevitServices.Transactions import TransactionManager
#Cho phép truy cập đến các node ở trong dynamo mà liên quan tới Revit:
clr.AddReference('RevitNodes')
import Revit
clr.AddReference('ProtoGeometry')
from Autodesk.DesignScript.Geometry import *
#Tham chiếu đến các element, geometry trong dynamo:
clr.ImportExtensions(Revit.Elements)
clr.ImportExtensions(Revit.GeometryConversion)
#Tham chiếu đến thư viện của Revit và Revit API
clr.AddReference('RevitAPIUI')
from Autodesk.Revit.UI import *
from Autodesk.Revit.UI.Selection import *
clr.AddReference('RevitAPI')
from Autodesk.Revit.DB import *
#Tham chiếu đến module giao diện người dùng (thư viện đồ họa)
clr.AddReference('System.Windows.Forms')
clr.AddReference('System.Drawing')
clr.AddReference('System.Windows.Forms.DataVisualization') #Trực quan hóa dữ liệu. Biểu thị dữ liệu dưới dạng chart,đồ thị..
import System.Windows.Forms
import System.Drawing
from System.Drawing import *
from System.Windows.Forms import *
from System.Collections.Generic import *
#Lấy đối tượng document
doc = DocumentManager.Instance.CurrentDBDocument #Đại diện cho 1 dự án đang được mở (view hiện hành)
view = doc.ActiveView
uidoc = DocumentManager.Instance.CurrentUIApplication.ActiveUIDocument #Có thể truy cập các data từ RevitAPI

#Code 
ref = uidoc.Selection.PickObjects(ObjectType.Element,'Please select model element')
result = []
for i in ref:
    element = doc.GetElement(i.ElementId)
    result.append(element.ToDSType(True))
OUT = result
# ----------------------------------------

# group: Select Model Element
boolean_2 = BoolSelector(false)
select_model_element = Python(IN[0]=boolean_2)  # frozen
# ---------- select_model_element.python (41 lines) ----------
import sys
import clr
#Cho Phép truy cập đến các đối tượng, view, sheet, element.... trong view hiện hành và chỉnh sửa được nó:
clr.AddReference('RevitServices')
import RevitServices
from RevitServices.Persistence import DocumentManager
from RevitServices.Transactions import TransactionManager
#Cho phép truy cập đến các node ở trong dynamo mà liên quan tới Revit:
clr.AddReference('RevitNodes')
import Revit
clr.AddReference('ProtoGeometry')
from Autodesk.DesignScript.Geometry import *
#Tham chiếu đến các element, geometry trong dynamo:
clr.ImportExtensions(Revit.Elements)
clr.ImportExtensions(Revit.GeometryConversion)
#Tham chiếu đến thư viện của Revit và Revit API
clr.AddReference('RevitAPIUI')
from Autodesk.Revit.UI import *
from Autodesk.Revit.UI.Selection import *
clr.AddReference('RevitAPI')
from Autodesk.Revit.DB import *
#Tham chiếu đến module giao diện người dùng (thư viện đồ họa)
clr.AddReference('System.Windows.Forms')
clr.AddReference('System.Drawing')
clr.AddReference('System.Windows.Forms.DataVisualization') #Trực quan hóa dữ liệu. Biểu thị dữ liệu dưới dạng chart,đồ thị..
import System.Windows.Forms
import System.Drawing
from System.Drawing import *
from System.Windows.Forms import *
from System.Collections.Generic import *
#Lấy đối tượng document
doc = DocumentManager.Instance.CurrentDBDocument #Đại diện cho 1 dự án đang được mở (view hiện hành)
view = doc.ActiveView
uidoc = DocumentManager.Instance.CurrentUIApplication.ActiveUIDocument #Có thể truy cập các data từ RevitAPI

#Code 
obType = ObjectType.Element
ref = uidoc.Selection.PickObject(obType,'Please select model element')
el = doc.GetElement(ref.ElementId)

OUT = el
# ----------------------------------------

# group: Select Face
boolean_3 = BoolSelector(true)
select_face = Python(IN[0]=boolean_3)  # frozen
# ---------- select_face.python (41 lines) ----------
import sys
import clr
#Cho Phép truy cập đến các đối tượng, view, sheet, element.... trong view hiện hành và chỉnh sửa được nó:
clr.AddReference('RevitServices')
import RevitServices
from RevitServices.Persistence import DocumentManager
from RevitServices.Transactions import TransactionManager
#Cho phép truy cập đến các node ở trong dynamo mà liên quan tới Revit:
clr.AddReference('RevitNodes')
import Revit
clr.AddReference('ProtoGeometry')
from Autodesk.DesignScript.Geometry import *
#Tham chiếu đến các element, geometry trong dynamo:
clr.ImportExtensions(Revit.Elements)
clr.ImportExtensions(Revit.GeometryConversion)
#Tham chiếu đến thư viện của Revit và Revit API
clr.AddReference('RevitAPIUI')
from Autodesk.Revit.UI import *
from Autodesk.Revit.UI.Selection import *
clr.AddReference('RevitAPI')
from Autodesk.Revit.DB import *
#Tham chiếu đến module giao diện người dùng (thư viện đồ họa)
clr.AddReference('System.Windows.Forms')
clr.AddReference('System.Drawing')
clr.AddReference('System.Windows.Forms.DataVisualization') #Trực quan hóa dữ liệu. Biểu thị dữ liệu dưới dạng chart,đồ thị..
import System.Windows.Forms
import System.Drawing
from System.Drawing import *
from System.Windows.Forms import *
from System.Collections.Generic import *
#Lấy đối tượng document
doc = DocumentManager.Instance.CurrentDBDocument #Đại diện cho 1 dự án đang được mở (view hiện hành)
view = doc.ActiveView
uidoc = DocumentManager.Instance.CurrentUIApplication.ActiveUIDocument #Có thể truy cập các data từ RevitAPI

#Code 
ref = uidoc.Selection.PickObject(ObjectType.Face,'Please select face')
e = uidoc.Document.GetElement(ref.ElementId)
get_Geo = e.GetGeometryObjectFromReference(ref)
get_Surface = get_Geo.ToProtoType(True)
OUT = get_Surface
# ----------------------------------------

# group: Select Faces to Lines
boolean_4 = BoolSelector(false)
select_faces_to_planarface = Python(IN[0]=boolean_4)  # frozen
# ---------- select_faces_to_planarface.python (44 lines) ----------
import sys
import clr
#Cho Phép truy cập đến các đối tượng, view, sheet, element.... trong view hiện hành và chỉnh sửa được nó:
clr.AddReference('RevitServices')
import RevitServices
from RevitServices.Persistence import DocumentManager
from RevitServices.Transactions import TransactionManager
#Cho phép truy cập đến các node ở trong dynamo mà liên quan tới Revit:
clr.AddReference('RevitNodes')
import Revit
clr.AddReference('ProtoGeometry')
from Autodesk.DesignScript.Geometry import *
#Tham chiếu đến các element, geometry trong dynamo:
clr.ImportExtensions(Revit.Elements)
clr.ImportExtensions(Revit.GeometryConversion)
#Tham chiếu đến thư viện của Revit và Revit API
clr.AddReference('RevitAPIUI')
from Autodesk.Revit.UI import *
from Autodesk.Revit.UI.Selection import *
clr.AddReference('RevitAPI')
from Autodesk.Revit.DB import *
#Tham chiếu đến module giao diện người dùng (thư viện đồ họa)
clr.AddReference('System.Windows.Forms')
clr.AddReference('System.Drawing')
clr.AddReference('System.Windows.Forms.DataVisualization') #Trực quan hóa dữ liệu. Biểu thị dữ liệu dưới dạng chart,đồ thị..
import System.Windows.Forms
import System.Drawing
from System.Drawing import *
from System.Windows.Forms import *
from System.Collections.Generic import *
#Lấy đối tượng document
doc = DocumentManager.Instance.CurrentDBDocument #Đại diện cho 1 dự án đang được mở (view hiện hành)
view = doc.ActiveView
uidoc = DocumentManager.Instance.CurrentUIApplication.ActiveUIDocument #Có thể truy cập các data từ RevitAPI

#Code 
ref = uidoc.Selection.PickObjects(ObjectType.Face,'Please select face')
re= []
for i in ref:
    e = uidoc.Document.GetElement(i.ElementId)
    get_Geo = e.GetGeometryObjectFromReference(i)
    re.append(get_Geo.GetEdgesAsCurveLoops())

OUT = re
# ----------------------------------------
db_line_to_line_level_4 = Python(IN[0]=select_faces_to_planarface)
# ---------- db_line_to_line_level_4.python (31 lines) ----------
import sys
import clr
#Cho Phép truy cập đến các đối tượng, view, sheet, element.... trong view hiện hành và chỉnh sửa được nó:
clr.AddReference('RevitServices')
import RevitServices
from RevitServices.Persistence import DocumentManager
from RevitServices.Transactions import TransactionManager
#Cho phép truy cập đến các node ở trong dynamo mà liên quan tới Revit:
clr.AddReference('RevitNodes')
import Revit
clr.AddReference('ProtoGeometry')
from Autodesk.DesignScript.Geometry import *
#Tham chiếu đến các element, geometry trong dynamo:
clr.ImportExtensions(Revit.Elements)
clr.ImportExtensions(Revit.GeometryConversion)
#Tham chiếu đến thư viện của Revit và Revit API
clr.AddReference('RevitAPIUI')
from Autodesk.Revit.UI import *
from Autodesk.Revit.UI.Selection import *
clr.AddReference('RevitAPI')
from Autodesk.Revit.DB import *
#Tham chiếu đến module giao diện người dùng (thư viện đồ họa)
clr.AddReference('System.Windows.Forms')
clr.AddReference('System.Drawing')
clr.AddReference('System.Windows.Forms.DataVisualization') #Trực quan hóa dữ liệu. Biểu thị dữ liệu dưới dạng chart,đồ thị..
import System.Windows.Forms
import System.Drawing
from System.Drawing import *
from System.Windows.Forms import *
from System.Collections.Generic import *
OUT = [t.ToProtoType() for i in IN[0] for j in i for t in j]
# ----------------------------------------

# group: Select Edges to Lines
boolean_5 = BoolSelector(false)
select_edges = Python(IN[0]=boolean_5)  # frozen
# ---------- select_edges.python (44 lines) ----------
import sys
import clr
#Cho Phép truy cập đến các đối tượng, view, sheet, element.... trong view hiện hành và chỉnh sửa được nó:
clr.AddReference('RevitServices')
import RevitServices
from RevitServices.Persistence import DocumentManager
from RevitServices.Transactions import TransactionManager
#Cho phép truy cập đến các node ở trong dynamo mà liên quan tới Revit:
clr.AddReference('RevitNodes')
import Revit
clr.AddReference('ProtoGeometry')
from Autodesk.DesignScript.Geometry import *
#Tham chiếu đến các element, geometry trong dynamo:
clr.ImportExtensions(Revit.Elements)
clr.ImportExtensions(Revit.GeometryConversion)
#Tham chiếu đến thư viện của Revit và Revit API
clr.AddReference('RevitAPIUI')
from Autodesk.Revit.UI import *
from Autodesk.Revit.UI.Selection import *
clr.AddReference('RevitAPI')
from Autodesk.Revit.DB import *
#Tham chiếu đến module giao diện người dùng (thư viện đồ họa)
clr.AddReference('System.Windows.Forms')
clr.AddReference('System.Drawing')
clr.AddReference('System.Windows.Forms.DataVisualization') #Trực quan hóa dữ liệu. Biểu thị dữ liệu dưới dạng chart,đồ thị..
import System.Windows.Forms
import System.Drawing
from System.Drawing import *
from System.Windows.Forms import *
from System.Collections.Generic import *
#Lấy đối tượng document
doc = DocumentManager.Instance.CurrentDBDocument #Đại diện cho 1 dự án đang được mở (view hiện hành)
view = doc.ActiveView
uidoc = DocumentManager.Instance.CurrentUIApplication.ActiveUIDocument #Có thể truy cập các data từ RevitAPI

#Code 
ref = uidoc.Selection.PickObjects(ObjectType.Edge,'Please select Edges')
edges = []
for i in range(len(ref)):
    el = doc.GetElement(ref[i].ElementId)
    edge = el.GetGeometryObjectFromReference(ref[i])
    edges.append(edge.AsCurve().ToProtoType())

OUT = edges
# ----------------------------------------

# group: Select Face to Line
boolean_6 = BoolSelector(true)
select_face_to_planarface = Python(IN[0]=boolean_6)  # frozen
# ---------- select_face_to_planarface.python (42 lines) ----------
import sys
import clr
#Cho Phép truy cập đến các đối tượng, view, sheet, element.... trong view hiện hành và chỉnh sửa được nó:
clr.AddReference('RevitServices')
import RevitServices
from RevitServices.Persistence import DocumentManager
from RevitServices.Transactions import TransactionManager
#Cho phép truy cập đến các node ở trong dynamo mà liên quan tới Revit:
clr.AddReference('RevitNodes')
import Revit
clr.AddReference('ProtoGeometry')
from Autodesk.DesignScript.Geometry import *
#Tham chiếu đến các element, geometry trong dynamo:
clr.ImportExtensions(Revit.Elements)
clr.ImportExtensions(Revit.GeometryConversion)
#Tham chiếu đến thư viện của Revit và Revit API
clr.AddReference('RevitAPIUI')
from Autodesk.Revit.UI import *
from Autodesk.Revit.UI.Selection import *
clr.AddReference('RevitAPI')
from Autodesk.Revit.DB import *
#Tham chiếu đến module giao diện người dùng (thư viện đồ họa)
clr.AddReference('System.Windows.Forms')
clr.AddReference('System.Drawing')
clr.AddReference('System.Windows.Forms.DataVisualization') #Trực quan hóa dữ liệu. Biểu thị dữ liệu dưới dạng chart,đồ thị..
import System.Windows.Forms
import System.Drawing
from System.Drawing import *
from System.Windows.Forms import *
from System.Collections.Generic import *
#Lấy đối tượng document
doc = DocumentManager.Instance.CurrentDBDocument #Đại diện cho 1 dự án đang được mở (view hiện hành)
view = doc.ActiveView
uidoc = DocumentManager.Instance.CurrentUIApplication.ActiveUIDocument #Có thể truy cập các data từ RevitAPI

#Code 
ref = uidoc.Selection.PickObject(ObjectType.Face,'Please select face')
e = uidoc.Document.GetElement(ref.ElementId)
get_Geo = e.GetGeometryObjectFromReference(ref)
get_Surface = get_Geo.ToProtoType()
get_Line = get_Geo.GetEdgesAsCurveLoops()
OUT = get_Line
# ----------------------------------------
db_line_to_line_level_3 = Python(IN[0]=select_face_to_planarface)
# ---------- db_line_to_line_level_3.python (31 lines) ----------
import sys
import clr
#Cho Phép truy cập đến các đối tượng, view, sheet, element.... trong view hiện hành và chỉnh sửa được nó:
clr.AddReference('RevitServices')
import RevitServices
from RevitServices.Persistence import DocumentManager
from RevitServices.Transactions import TransactionManager
#Cho phép truy cập đến các node ở trong dynamo mà liên quan tới Revit:
clr.AddReference('RevitNodes')
import Revit
clr.AddReference('ProtoGeometry')
from Autodesk.DesignScript.Geometry import *
#Tham chiếu đến các element, geometry trong dynamo:
clr.ImportExtensions(Revit.Elements)
clr.ImportExtensions(Revit.GeometryConversion)
#Tham chiếu đến thư viện của Revit và Revit API
clr.AddReference('RevitAPIUI')
from Autodesk.Revit.UI import *
from Autodesk.Revit.UI.Selection import *
clr.AddReference('RevitAPI')
from Autodesk.Revit.DB import *
#Tham chiếu đến module giao diện người dùng (thư viện đồ họa)
clr.AddReference('System.Windows.Forms')
clr.AddReference('System.Drawing')
clr.AddReference('System.Windows.Forms.DataVisualization') #Trực quan hóa dữ liệu. Biểu thị dữ liệu dưới dạng chart,đồ thị..
import System.Windows.Forms
import System.Drawing
from System.Drawing import *
from System.Windows.Forms import *
from System.Collections.Generic import *
OUT = [j.ToProtoType() for i in IN[0] for j in i]
# ----------------------------------------

# group: Select Face to Line
boolean_7 = BoolSelector(false)
select_edge = Python(IN[0]=boolean_7)  # frozen
# ---------- select_edge.python (42 lines) ----------
import sys
import clr
#Cho Phép truy cập đến các đối tượng, view, sheet, element.... trong view hiện hành và chỉnh sửa được nó:
clr.AddReference('RevitServices')
import RevitServices
from RevitServices.Persistence import DocumentManager
from RevitServices.Transactions import TransactionManager
#Cho phép truy cập đến các node ở trong dynamo mà liên quan tới Revit:
clr.AddReference('RevitNodes')
import Revit
clr.AddReference('ProtoGeometry')
from Autodesk.DesignScript.Geometry import *
#Tham chiếu đến các element, geometry trong dynamo:
clr.ImportExtensions(Revit.Elements)
clr.ImportExtensions(Revit.GeometryConversion)
#Tham chiếu đến thư viện của Revit và Revit API
clr.AddReference('RevitAPIUI')
from Autodesk.Revit.UI import *
from Autodesk.Revit.UI.Selection import *
clr.AddReference('RevitAPI')
from Autodesk.Revit.DB import *
#Tham chiếu đến module giao diện người dùng (thư viện đồ họa)
clr.AddReference('System.Windows.Forms')
clr.AddReference('System.Drawing')
clr.AddReference('System.Windows.Forms.DataVisualization') #Trực quan hóa dữ liệu. Biểu thị dữ liệu dưới dạng chart,đồ thị..
import System.Windows.Forms
import System.Drawing
from System.Drawing import *
from System.Windows.Forms import *
from System.Collections.Generic import *
#Lấy đối tượng document
doc = DocumentManager.Instance.CurrentDBDocument #Đại diện cho 1 dự án đang được mở (view hiện hành)
view = doc.ActiveView
uidoc = DocumentManager.Instance.CurrentUIApplication.ActiveUIDocument #Có thể truy cập các data từ RevitAPI

#Code 
ref = uidoc.Selection.PickObject(ObjectType.Edge,'Please select Edge')
fa = doc.GetElement(ref.ElementId)
edge = fa.GetGeometryObjectFromReference(ref)
get_edge = edge.AsCurve().ToProtoType()

OUT = get_edge
# ----------------------------------------

# group: Select Pick Point
boolean_8 = BoolSelector(true)
select_pick_point = Python(IN[0]=boolean_8)  # frozen
# ---------- select_pick_point.python (38 lines) ----------
import sys
import clr
#Cho Phép truy cập đến các đối tượng, view, sheet, element.... trong view hiện hành và chỉnh sửa được nó:
clr.AddReference('RevitServices')
import RevitServices
from RevitServices.Persistence import DocumentManager
from RevitServices.Transactions import TransactionManager
#Cho phép truy cập đến các node ở trong dynamo mà liên quan tới Revit:
clr.AddReference('RevitNodes')
import Revit
clr.AddReference('ProtoGeometry')
from Autodesk.DesignScript.Geometry import *
#Tham chiếu đến các element, geometry trong dynamo:
clr.ImportExtensions(Revit.Elements)
clr.ImportExtensions(Revit.GeometryConversion)
#Tham chiếu đến thư viện của Revit và Revit API
clr.AddReference('RevitAPIUI')
from Autodesk.Revit.UI import *
from Autodesk.Revit.UI.Selection import *
clr.AddReference('RevitAPI')
from Autodesk.Revit.DB import *
#Tham chiếu đến module giao diện người dùng (thư viện đồ họa)
clr.AddReference('System.Windows.Forms')
clr.AddReference('System.Drawing')
clr.AddReference('System.Windows.Forms.DataVisualization') #Trực quan hóa dữ liệu. Biểu thị dữ liệu dưới dạng chart,đồ thị..
import System.Windows.Forms
import System.Drawing
from System.Drawing import *
from System.Windows.Forms import *
from System.Collections.Generic import *
#Lấy đối tượng document
doc = DocumentManager.Instance.CurrentDBDocument #Đại diện cho 1 dự án đang được mở (view hiện hành)
view = doc.ActiveView
uidoc = DocumentManager.Instance.CurrentUIApplication.ActiveUIDocument #Có thể truy cập các data từ RevitAPI

#Code 
point = uidoc.Selection.PickPoint(ObjectSnapTypes.None,'Please Select Pick Point')
OUT = point
# ----------------------------------------

boolean_9 = BoolSelector(true)
categories = Categories("OST_GenericModel")
python_script = Python(IN[0]=boolean_9, IN[1]=categories)  # frozen
# ---------- python_script.python (51 lines) ----------
import sys
import clr
#Cho Phép truy cập đến các đối tượng, view, sheet, element.... trong view hiện hành và chỉnh sửa được nó:
clr.AddReference('RevitServices')
import RevitServices
from RevitServices.Persistence import DocumentManager
from RevitServices.Transactions import TransactionManager
#Cho phép truy cập đến các node ở trong dynamo mà liên quan tới Revit:
clr.AddReference('RevitNodes')
import Revit
clr.AddReference('ProtoGeometry')
from Autodesk.DesignScript.Geometry import *
#Tham chiếu đến các element, geometry trong dynamo:
clr.ImportExtensions(Revit.Elements)
clr.ImportExtensions(Revit.GeometryConversion)
#Tham chiếu đến thư viện của Revit và Revit API
clr.AddReference('RevitAPIUI')
from Autodesk.Revit.UI import *
from Autodesk.Revit.UI.Selection import *
clr.AddReference('RevitAPI')
from Autodesk.Revit.DB import *
#Tham chiếu đến module giao diện người dùng (thư viện đồ họa)
clr.AddReference('System.Windows.Forms')
clr.AddReference('System.Drawing')
clr.AddReference('System.Windows.Forms.DataVisualization') #Trực quan hóa dữ liệu. Biểu thị dữ liệu dưới dạng chart,đồ thị..
import System.Windows.Forms
import System.Drawing
from System.Drawing import *
from System.Windows.Forms import *
from System.Collections.Generic import *
#Lấy đối tượng document
doc = DocumentManager.Instance.CurrentDBDocument #Đại diện cho 1 dự án đang được mở (view hiện hành)
view = doc.ActiveView
uidoc = DocumentManager.Instance.CurrentUIApplication.ActiveUIDocument #Có thể truy cập các data từ RevitAPI

#Code 
class selectionfilter(ISelectionFilter):
    def __init__(self,category):
        self.category = category
    def AllowElement(self, element):
        if element.Category.Name in [c.Name for c in self.category]:
            return True
        else:
            return False
    def AllowReference(reference, point):
        return False
        
category = [UnwrapElement(IN[1])]
selffilt = selectionfilter(category)
ele = uidoc.Selection.PickElementsByRectangle(selffilt,"Select Project")
OUT = ele
# ----------------------------------------
