# Dynamo graph Test Code.dyn (Dynamo 2.3.0.5885)

boolean = BoolSelector(true)
file_path = Filename(".\MainFormModelCad.py")
python_script = Python(IN[0]=boolean, IN[1]=file_path)
# ---------- python_script.python (4 lines) ----------
if IN[0] == True:
	OUT = IN[1]
else:
	OUT = IN[1]
# ----------------------------------------
readText = FileSystem.ReadText(file=python_script)
python_script_from_string = PythonStringNode(script=readText)  # unwired: IN[0]
type = Object.Type(obj=python_script_from_string)
boolean_2 = BoolSelector(true)
code_block = CodeBlock(a=python_script_from_string) { a[6]; }
python_script_2 = Python(IN[0]=boolean_2, IN[1]=python_script_from_string, IN[2]=code_block)  # frozen
# ---------- python_script_2.python (44 lines) ----------
import sys
import clr
clr.AddReference('RevitServices')
import RevitServices
from RevitServices.Persistence import DocumentManager
from RevitServices.Transactions import TransactionManager
#Cho phép truy cập đến các node ở trong dynamo 
clr.AddReference('RevitNodes')
import Revit
clr.AddReference('ProtoGeometry')
from Autodesk.DesignScript.Geometry import *
#Tham chiếu đến các element, geometry 
clr.ImportExtensions(Revit.Elements)
clr.ImportExtensions(Revit.GeometryConversion)
#Tham chiếu đến thư viện của Revit và Revit API
clr.AddReference('RevitAPIUI')
from Autodesk.Revit.UI import *
from Autodesk.Revit.UI.Selection import *
clr.AddReference('RevitAPI')
from Autodesk.Revit.DB import *
#Tham chiếu đến module giao diện 
clr.AddReference('System.Windows.Forms')
clr.AddReference('System.Drawing')
clr.AddReference('System.Windows.Forms.DataVisualization') 
import System.Windows.Forms
import System.Drawing
from System.Drawing import *
from System.Windows.Forms import *
from System.Collections.Generic import *
import ngodinhcanh as ndc 
#Lấy đối tượng document
doc = DocumentManager.Instance.CurrentDBDocument 
view = doc.ActiveView
uidoc = DocumentManager.Instance.CurrentUIApplication.ActiveUIDocument 

layerName = IN[1][0]
SelectedCadLink = IN[2]
allSolid = ndc.GetSolids(SelectedCadLink)
# allHatchs = ndc.GetHatchLayerName(SelectedCadLink,layerName)   
# allCurve = [ndc.allCurves(i) for i in allHatchs]
# len_ShortLong = [ndc.getCurveShortLong(i) for i in allCurve]
# vertice_Column = [ndc.verticesColumn(i) for i in allHatchs]
# angel = [ndc.Angel(i) for i in (len_ShortLong[3][3])]
OUT = allSolid
# ----------------------------------------
boolean_3 = BoolSelector(true)
code_block_2 = CodeBlock(a=python_script_from_string) { a[0]; }
python_script_3 = Python(IN[0]=boolean_3, IN[1]=code_block, IN[2]=code_block_2)  # frozen
# ---------- python_script_3.python (67 lines) ----------
import sys
import clr
from ngodinhcanh import GetHatchLayerName
clr.AddReference('RevitServices')
import RevitServices
from RevitServices.Persistence import DocumentManager
from RevitServices.Transactions import TransactionManager
#Cho phép truy cập đến các node ở trong dynamo 
clr.AddReference('RevitNodes')
import Revit
clr.AddReference('ProtoGeometry')
from Autodesk.DesignScript.Geometry import *
#Tham chiếu đến các element, geometry 
clr.ImportExtensions(Revit.Elements)
clr.ImportExtensions(Revit.GeometryConversion)
#Tham chiếu đến thư viện của Revit và Revit API
clr.AddReference('RevitAPIUI')
from Autodesk.Revit.UI import *
from Autodesk.Revit.UI.Selection import *
clr.AddReference('RevitAPI')
from Autodesk.Revit.DB import *
#Tham chiếu đến module giao diện 
clr.AddReference('System.Windows.Forms')
clr.AddReference('System.Drawing')
clr.AddReference('System.Windows.Forms.DataVisualization') 
import System.Windows.Forms
import System.Drawing
from System.Drawing import *
from System.Windows.Forms import *
from System.Collections.Generic import *
#Lấy đối tượng document
doc = DocumentManager.Instance.CurrentDBDocument 
view = doc.ActiveView
uidoc = DocumentManager.Instance.CurrentUIApplication.ActiveUIDocument 

obType = ObjectType.Element
ref = uidoc.Selection.PickObject(obType,'Please select model Cad import')
SelectedCadLink = doc.GetElement(ref)
SelectedCadLink2 = IN[1]
LayerName = IN[2]
def GetSolids(cadInstance):
    opt = Options()
    allSolids = []
    geoElement = cadInstance.get_Geometry(opt)
    for geoObject in geoElement:
        geoInstance = geoObject.GetInstanceGeometry()
        for geoObject2 in geoInstance: 
            if geoObject2.GetType() == Solid and geoObject2.SurfaceArea > 0 :
               allSolids.append(geoObject2)
    return allSolids
def GetHatchLayerName(cadInstance,layerName):
    allHatch = []
    solids = GetSolids(cadInstance)
    if solids.Count == 0:
         return allHatch
    for solid in solids:
        for face in solid.Faces :
            graphicsStyle = cadInstance.Document.GetElement(face.GraphicsStyleId)
            if graphicsStyle == None :
                continue
            styleCategory = graphicsStyle.GraphicsStyleCategory
            if styleCategory.Name.Equals(layerName):
                allHatch.Add(face)
    return allHatch
allHatchs = GetHatchLayerName(SelectedCadLink,LayerName)
allSolids = GetSolids(SelectedCadLink)
OUT = allSolids,SelectedCadLink,allHatchs,SelectedCadLink
# ----------------------------------------
