# Dynamo graph Test Code2.dyn (Dynamo 2.6.1.8786)
# packages: bimorphNodes 3.0.3, archi-lab.net 2021.25.13

python_script = Python()  # frozen; unwired: IN[0], IN[1]
# ---------- python_script.python (78 lines) ----------
import sys
import clr
import math
clr.AddReference('RevitServices')
import RevitServices
from RevitServices.Persistence import DocumentManager
from RevitServices.Transactions import TransactionManager
#Cho phép truy cập đến các node ở trong dynamo 
clr.AddReference('RevitNodes')
import Revit
clr.AddReference('ProtoGeometry')
from Autodesk.DesignScript.Geometry import *
#Tham chiếu đến các element, geometry 
clr.ImportExtensions(Revit.Elements)
clr.ImportExtensions(Revit.GeometryConversion)
#Tham chiếu đến thư viện của Revit và Revit API
clr.AddReference('RevitAPIUI')
from Autodesk.Revit.UI import *
from Autodesk.Revit.UI.Selection import *
clr.AddReference('RevitAPI')
from Autodesk.Revit.DB import *
#Tham chiếu đến module giao diện 
clr.AddReference('System.Windows.Forms')
clr.AddReference('System.Drawing')
clr.AddReference('System.Windows.Forms.DataVisualization') 
import System.Windows.Forms
import System.Drawing
from System.Drawing import *
from System.Windows.Forms import *
from System.Collections.Generic import *
#Lấy đối tượng document
doc = DocumentManager.Instance.CurrentDBDocument 
view = doc.ActiveView
uidoc = DocumentManager.Instance.CurrentUIApplication.ActiveUIDocument 


a = UnwrapElement(IN[1])

def GetFamilySymbolColumn(family,b,h,bPara,hPara) :
    allFamilySymbol = family.GetAllFamilySymbol()
    bParameter = allFamilySymbol[0].LookupParameter(bPara)
    hParameter = allFamilySymbol[0].LookupParameter(hPara)
    if (bParameter == None or hParameter == None) :
        return None
        
    for symbol in allFamilySymbol:
        bParameter = symbol.LookupParameter(bPara)
        hParameter = symbol.LookupParameter(hPara)

        # b_value = Convert.ToDouble(bParameter.GetValue())
        # h_value = Convert.ToDouble(hParameter.GetValue())

        b_value = bParameter.AsDouble()
        h_value = hParameter.AsDouble()

        if (math.Abs(b_value - b) < 0.001 & math.Abs(h_value - h) < 0.001) :

            return symbol
        
        newName = str.Concat((b*304.8).ToString(), 
                "x", (h*304.8).ToString())

        if (newName.Equals("0x0")): 
            return None
            # if (name.Equals("0x0") || Math.Abs(sectionX) < 0.01 ||
            #     Math.Abs(sectionY) < 0.01) return null;

        result = None
        tx = Transaction(family.Document)    
        tx.Start("Create new Column Type")
        s1 = allFamilySymbol[0].Duplicate(newName)
        s1.LookupParameter(bPara).Set(b)
        s1.LookupParameter(hPara).Set(h)
        result.Add(s1)
        tx.Commit()        
    return result
c = GetFamilySymbolColumn(a,10,10,"b","h")  
OUT = b ,c
# ----------------------------------------

# group: Form
boolean = BoolSelector(true)

formModelInCad = Python(IN[0]=boolean)
# ---------- formModelInCad.python (307 lines) ----------
import sys
import clr
clr.AddReference('RevitServices')
import RevitServices
from RevitServices.Persistence import DocumentManager
from RevitServices.Transactions import TransactionManager
clr.AddReference('RevitNodes')
import Revit
clr.AddReference('ProtoGeometry')
from Autodesk.DesignScript.Geometry import *
clr.ImportExtensions(Revit.Elements)
clr.ImportExtensions(Revit.GeometryConversion)
clr.AddReference('RevitAPIUI')
from Autodesk.Revit.UI import *
from Autodesk.Revit.UI.Selection import *
clr.AddReference('RevitAPI')
from Autodesk.Revit.DB import * 
clr.AddReference('System.Windows.Forms')
clr.AddReference('System.Drawing')
clr.AddReference('System.Windows.Forms.DataVisualization') 
import System.Windows.Forms
import System.Drawing
from System.Drawing import *
from System.Windows.Forms import *
from System.Collections.Generic import *
# import ngodinhcanh as ndc 

doc = DocumentManager.Instance.CurrentDBDocument 
view = doc.ActiveView
uidoc = DocumentManager.Instance.CurrentUIApplication.ActiveUIDocument 

obType = ObjectType.Element
ref = uidoc.Selection.PickObject(obType,'Please select model Cad import')
SelectedCadLink = doc.GetElement(ref)

clr.AddReference("DSCoreNodes")
import DSCore
rtn=[]
cat=SelectedCadLink.Category.SubCategories.GetEnumerator()
while cat.MoveNext():
	rtn.append(cat.Current.Name)
	DSCore.List.Sort(rtn)

fasymbol = FilteredElementCollector(doc).OfClass(FamilySymbol).ToElements()
symbol = []
symbol1= []
for i in fasymbol:
    if i.FamilyName == "ALB_STR_Rectangular Concrete Column":
        symbol.append(i.FamilyName)
        symbol1.append(i)
# Level Name
lv = FilteredElementCollector(doc).OfClass(Level).WhereElementIsNotElementType().ToElements()
lvs = []
for i in lv:
	lvs.append(Element.Name.__get__(i))
# def trả về Element 
def get_element(lst,string):
	for i in lst:
		if Element.Name.__get__(i)== string: return i
def get_element2(lst,string):
	for i in lst:
		if i.FamilyName == string: return i		

def GetSolids(cadInstance):
    opt = Options()
    allSolids = []
    geoElement = cadInstance.get_Geometry(opt)
    for geoObject in geoElement:
        geoInstance = geoObject.GetInstanceGeometry()
        for geoObject2 in geoInstance: 
            if geoObject2.GetType() == Solid and geoObject2.SurfaceArea > 0 :
               allSolids.append(geoObject2)
    return allSolids
# Form 
class MainForm(Form):
	def __init__(self):
		self.InitializeComponent()
	
	def InitializeComponent(self):
		self._groupBox1 = System.Windows.Forms.GroupBox()
		self._comboBox1 = System.Windows.Forms.ComboBox()
		self._comboBox2 = System.Windows.Forms.ComboBox()
		self._groupBox2 = System.Windows.Forms.GroupBox()
		self._btnOk = System.Windows.Forms.Button()
		self._btnCancel = System.Windows.Forms.Button()
		self._comboBox3 = System.Windows.Forms.ComboBox()
		self._comboBox4 = System.Windows.Forms.ComboBox()
		self._label1 = System.Windows.Forms.Label()
		self._label2 = System.Windows.Forms.Label()
		self._label3 = System.Windows.Forms.Label()
		self._label4 = System.Windows.Forms.Label()
		self._label5 = System.Windows.Forms.Label()
		self._label6 = System.Windows.Forms.Label()
		self._textBox1 = System.Windows.Forms.TextBox()
		self._textBox2 = System.Windows.Forms.TextBox()
		self._groupBox1.SuspendLayout()
		self._groupBox2.SuspendLayout()
		self.SuspendLayout()
		# 
		# groupBox1
		# 
		self._groupBox1.Controls.Add(self._label2)
		self._groupBox1.Controls.Add(self._label1)
		self._groupBox1.Controls.Add(self._comboBox2)
		self._groupBox1.Controls.Add(self._comboBox1)
		self._groupBox1.Location = System.Drawing.Point(12, 1)
		self._groupBox1.Name = "groupBox1"
		self._groupBox1.Size = System.Drawing.Size(459, 79)
		self._groupBox1.TabIndex = 0
		self._groupBox1.TabStop = False
		self._groupBox1.Text = "Input Data"
		# 
		# groupBox2
		# 
		self._groupBox2.Controls.Add(self._textBox2)
		self._groupBox2.Controls.Add(self._textBox1)
		self._groupBox2.Controls.Add(self._label5)
		self._groupBox2.Controls.Add(self._label6)
		self._groupBox2.Controls.Add(self._label4)
		self._groupBox2.Controls.Add(self._label3)
		self._groupBox2.Controls.Add(self._comboBox4)
		self._groupBox2.Controls.Add(self._comboBox3)
		self._groupBox2.Location = System.Drawing.Point(12, 85)
		self._groupBox2.Name = "groupBox2"
		self._groupBox2.Size = System.Drawing.Size(459, 70)
		self._groupBox2.TabIndex = 1
		self._groupBox2.TabStop = False
		# 
		# comboBox1
		# 
		self._comboBox1.DropDownStyle = System.Windows.Forms.ComboBoxStyle.DropDownList
		self._comboBox1.FormattingEnabled = True
		self._comboBox1.Location = System.Drawing.Point(86, 15)
		self._comboBox1.Name = "comboBox1"
		self._comboBox1.Size = System.Drawing.Size(351, 21)
		self._comboBox1.TabIndex = 0
		self._comboBox1.Items.AddRange(System.Array[System.Object](rtn))
		# 
		# comboBox2
		# 
		self._comboBox2.DropDownStyle = System.Windows.Forms.ComboBoxStyle.DropDownList
		self._comboBox2.FormattingEnabled = True
		self._comboBox2.Location = System.Drawing.Point(86, 50)
		self._comboBox2.Name = "comboBox2"
		self._comboBox2.Size = System.Drawing.Size(351, 21)
		self._comboBox2.TabIndex = 1
		self._comboBox2.Items.AddRange(System.Array[System.Object](symbol))
		# 
		# comboBox3
		#
		self._comboBox3.DropDownStyle = System.Windows.Forms.ComboBoxStyle.DropDownList		
		self._comboBox3.FormattingEnabled = True
		self._comboBox3.Location = System.Drawing.Point(123, 12)
		self._comboBox3.Name = "comboBox3"
		self._comboBox3.Size = System.Drawing.Size(121, 21)
		self._comboBox3.TabIndex = 0
		self._comboBox3.Items.AddRange(System.Array[System.Object](lvs))
		# 
		# comboBox4
		# 
		self._comboBox4.DropDownStyle = System.Windows.Forms.ComboBoxStyle.DropDownList
		self._comboBox4.FormattingEnabled = True
		self._comboBox4.Location = System.Drawing.Point(124, 40)
		self._comboBox4.Name = "comboBox4"
		self._comboBox4.Size = System.Drawing.Size(120, 21)
		self._comboBox4.TabIndex = 1
		self._comboBox4.Items.AddRange(System.Array[System.Object](lvs))
		# 
		# btnOk
		# 
		self._btnOk.Location = System.Drawing.Point(315, 161)
		self._btnOk.Name = "btnOk"
		self._btnOk.Size = System.Drawing.Size(75, 29)
		self._btnOk.TabIndex = 2
		self._btnOk.Text = "Ok"
		self._btnOk.UseVisualStyleBackColor = True
		self._btnOk.Click += self.BtnOkClick
		# 
		# btnCancel
		# 
		self._btnCancel.Location = System.Drawing.Point(396, 161)
		self._btnCancel.Name = "btnCancel"
		self._btnCancel.Size = System.Drawing.Size(75, 29)
		self._btnCancel.TabIndex = 3
		self._btnCancel.Text = "Cancel"
		self._btnCancel.UseVisualStyleBackColor = True
		self._btnCancel.Click += self.BtnCancelClick

		# 
		# label1
		# 
		self._label1.Location = System.Drawing.Point(7, 18)
		self._label1.Name = "label1"
		self._label1.Size = System.Drawing.Size(73, 23)
		self._label1.TabIndex = 2
		self._label1.Text = "Layer Name :"
		# 
		# label2
		# 
		self._label2.Location = System.Drawing.Point(7, 52)
		self._label2.Name = "label2"
		self._label2.Size = System.Drawing.Size(75, 23)
		self._label2.TabIndex = 3
		self._label2.Text = "Family Name:"
		# 
		# label3
		# 
		self._label3.Location = System.Drawing.Point(7, 15)
		self._label3.Name = "label3"
		self._label3.Size = System.Drawing.Size(110, 23)
		self._label3.TabIndex = 3
		self._label3.Text = "Choose Base Level:"
		# 
		# label4
		# 
		self._label4.Location = System.Drawing.Point(7, 43)
		self._label4.Name = "label4"
		self._label4.Size = System.Drawing.Size(110, 23)
		self._label4.TabIndex = 4
		self._label4.Text = "Choose Top Level :"
		# 
		# label5
		# 
		self._label5.Location = System.Drawing.Point(269, 43)
		self._label5.Name = "label5"
		self._label5.Size = System.Drawing.Size(73, 23)
		self._label5.TabIndex = 6
		self._label5.Text = "Top Level :"
		# 
		# label6
		# 
		self._label6.Location = System.Drawing.Point(269, 15)
		self._label6.Name = "label6"
		self._label6.Size = System.Drawing.Size(73, 23)
		self._label6.TabIndex = 5
		self._label6.Text = "Base Level:"
		# 
		# textBox1
		# 
		self._textBox1.Location = System.Drawing.Point(337, 13)
		self._textBox1.Name = "textBox1"
		self._textBox1.Size = System.Drawing.Size(100, 20)
		self._textBox1.TabIndex = 7
		self._textBox1.Text = "00"
		# 
		# textBox2
		# 
		self._textBox2.Location = System.Drawing.Point(337, 41)
		self._textBox2.Name = "textBox2"
		self._textBox2.Size = System.Drawing.Size(100, 20)
		self._textBox2.TabIndex = 8
		self._textBox2.Text = "00"
		# 
		# MainForm
		# 
		self.BackColor = System.Drawing.SystemColors.ControlLightLight
		self.ClientSize = System.Drawing.Size(492, 193)
		self.Controls.Add(self._btnCancel)
		self.Controls.Add(self._btnOk)
		self.Controls.Add(self._groupBox2)
		self.Controls.Add(self._groupBox1)
		self.Name = "MainForm"
		self.Text = "ModelFromCad"
		self.StartPosition = System.Windows.Forms.FormStartPosition.CenterScreen
		self._groupBox1.ResumeLayout(False)
		self._groupBox2.ResumeLayout(False)
		self._groupBox2.PerformLayout()
		self.ResumeLayout(False)
		self.btn_Ele = []
		self.allFamilies_Ele = []
		self.lvs_Ele1 = []
		self.lvs_Ele2 = []
		self.tx_Ele1 = []
		self.tx_Ele2 = []



	def BtnOkClick(self, sender, e):
		var1 = self._comboBox1.Text
		var2 = self._comboBox2.Text
		var3 = self._comboBox3.Text
		var4 = self._comboBox4.Text
		var5 = self._textBox1.Text
		var6 = self._textBox2.Text
		self.btn_Ele = var1
		self.allFamilies_Ele = symbol1
		self.lvs_Ele1 = get_element(lv,var3)
		self.lvs_Ele2 = get_element(lv,var4)
		self.tx_Ele1 = float(var5)
		self.tx_Ele2 = float(var6)
		self.Close()
		pass

	def BtnCancelClick(self, sender, e):
		self.Close()
		pass
f = MainForm()
Application.Run(f)
# allHatchs = ndc.GetHatchLayerName(SelectedCadLink,f.btn_Ele)   
# allCurve = ndc.allCurves(allHatchs)
# len_ShortLong = [ndc.getCurveShortLong(i) for i in allCurve]
# vertice_Column = [ndc.verticesColumn(i) for i in allHatchs]
# familySymbol = ndc.GetFamilySymbolColumn(f.allFamilies_Ele,len_ShortLong[1],len_ShortLong[2],"b","h")
# t = Transaction(doc,"Create Columns")
# t.Start()
# angel = [ndc.Angel(i) for i in (len_ShortLong[3][3])]
OUT = f.btn_Ele,f.allFamilies_Ele,f.lvs_Ele1,f.lvs_Ele2,f.tx_Ele1,f.tx_Ele2,SelectedCadLink
# ----------------------------------------

# group (continued): Form
code_block = CodeBlock(a=formModelInCad) { a[6]; a[0]; a[1]; a[2]; a[3]; a[4]; a[5]; }
curvesFromCADLayers = CAD.CurvesFromCADLayers(importInstance=code_block.out0, layerNames=code_block.out1)
flatten = List.Flatten(list=curvesFromCADLayers.Curve)
group_curves = Custom[Group Curves](curves=flatten)  # package archi-lab.net; This node will take any input of flat list of curves and group them into sublists containing "joinable" curves that is continous curves. They might form closed curves or open curves. Use PolyCurve.ByJoinedCurves to convert output groups of curves into single PolyCurves
byJoinedCurves = PolyCurve.ByJoinedCurves(curves=group_curves)

python_script_2 = Python(IN[1]=code_block.out0)  # frozen; unwired: IN[0]
# ---------- python_script_2.python (67 lines) ----------
import sys
import clr
clr.AddReference('RevitServices')
import RevitServices
from RevitServices.Persistence import DocumentManager
from RevitServices.Transactions import TransactionManager
#Cho phép truy cập đến các node ở trong dynamo 
clr.AddReference('RevitNodes')
import Revit
clr.AddReference('ProtoGeometry')
from Autodesk.DesignScript.Geometry import *
#Tham chiếu đến các element, geometry 
clr.ImportExtensions(Revit.Elements)
clr.ImportExtensions(Revit.GeometryConversion)
#Tham chiếu đến thư viện của Revit và Revit API
clr.AddReference('RevitAPIUI')
from Autodesk.Revit.UI import *
from Autodesk.Revit.UI.Selection import *
clr.AddReference('RevitAPI')
from Autodesk.Revit.DB import *
#Tham chiếu đến module giao diện 
clr.AddReference('System.Windows.Forms')
clr.AddReference('System.Drawing')
clr.AddReference('System.Windows.Forms.DataVisualization') 
import System.Windows.Forms
import System.Drawing
from System.Drawing import *
from System.Windows.Forms import *
from System.Collections.Generic import *
#Lấy đối tượng document
doc = DocumentManager.Instance.CurrentDBDocument 
view = doc.ActiveView
uidoc = DocumentManager.Instance.CurrentUIApplication.ActiveUIDocument 

# def allCurves(planarFace):
planarFace = IN[1]
allCurves = []
for edgeLoops in planarFace :
    edge_loops = edgeLoops.EdgeLoops
    for edgeArray in edge_loops:
        for edge in edgeArray:
           	allCurves.Add(edge.AsCurve())
# return allCurves
def getCurveShortLong(allCurve):
    len_curveShort = []
    len_curveLong = []
    curveShort = []
    curveLong = []
    if allCurve.Count == 4 :
        if allCurve[0].Length > allCurve[1].Length:
            len_curveShort.append(round(allCurve[1].Length))
            len_curveLong.append(round(allCurve[0].Length))
            curveShort.append(allCurve[1])
            curveLong.append(allCurve[0])
        else:
            len_curveShort.append(round(allCurve[0].Length))
            len_curveLong.append(round(allCurve[1].Length))
            curveShort.append(allCurve[0])
            curveLong.append(allCurve[1])
    else:
        return len_curveShort.append("None")

    return len_curveLong,len_curveShort,curveLong,curveShort
a = getCurveShortLong(allCurves)
OUT = a,allCurves

                   
# ----------------------------------------

# group: DataColumnGeometry
closeWithLine = PolyCurve.CloseWithLine(polyCurve=byJoinedCurves)
byPatch = Surface.ByPatch(closedCurve=closeWithLine)
code_block_2 = CodeBlock { 0; }
getIsoline = Surface.GetIsoline(surface=byPatch, isoDirection=code_block_2)
code_block_3 = CodeBlock { 1; }
getIsoline_2 = Surface.GetIsoline(surface=byPatch, isoDirection=code_block_3)
list_create = List.Create(item0=getIsoline, item1=getIsoline_2)
length = Curve.Length(curve=list_create)
code_block_4 = CodeBlock(a=length) { a[0]; }
code_block_5 = CodeBlock(a=length) { a[1]; }
gt = code_block_4 > code_block_5
if_ = If(test=gt, true=getIsoline_2, false=getIsoline)
code_block_6 = CodeBlock { 0.5; }
tangentAtParameter = Curve.TangentAtParameter(curve=if_, param=code_block_6)
code_block_7 = CodeBlock { 0.5; }
pointAtParameter = Surface.PointAtParameter(surface=byPatch, u=code_block_7, v=code_block_7)
code_block_8 = CodeBlock(a=pointAtParameter) { a; }
if_2 = If(test=gt, true=getIsoline, false=getIsoline_2)
list_create_2 = List.Create(item0=if_2, item1=if_)
length_2 = Curve.Length(curve=list_create_2)
code_block_9 = CodeBlock(a=length_2) { a[0]; a[1]; }

byPointAndLevel = FamilyInstance.ByPointAndLevel()  # unwired: familyType, point, level
setRotation = FamilyInstance.SetRotation(familyInstance=byPointAndLevel)  # unwired: degree
python_script_3 = Python(IN[0]=code_block.out0, IN[1]=code_block.out1)
# ---------- python_script_3.python (159 lines) ----------
import sys
from os import remove
import clr
import System
import math
from System.Collections.Generic import *

clr.AddReference('RevitServices')
import RevitServices
from RevitServices.Persistence import DocumentManager
from RevitServices.Transactions import TransactionManager
clr.AddReference('RevitNodes')
import Revit
clr.AddReference('ProtoGeometry')
from Autodesk.DesignScript.Geometry import *
clr.AddReference('RevitAPIUI')
from Autodesk.Revit.UI import *
from Autodesk.Revit.UI.Selection import *
clr.AddReference('RevitAPI')
import Autodesk
from Autodesk.Revit.DB import *

doc = DocumentManager.Instance.CurrentDBDocument 
view = doc.ActiveView
uidoc = DocumentManager.Instance.CurrentUIApplication.ActiveUIDocument
################################################################
def getlen_CurveShortLong(allCurve):
    len_curveShort = []
    len_curveLong = []
    curveShort = []
    curveLong = []
    if allCurve.Count == 4 :
        if allCurve[0].Length > allCurve[1].Length:
            len_curveShort.append(round(allCurve[1].Length))
            len_curveLong.append(round(allCurve[0].Length))
            curveShort.append(allCurve[1])
            curveLong.append(allCurve[0])
        else:
            len_curveShort.append(round(allCurve[0].Length))
            len_curveLong.append(round(allCurve[1].Length))
            curveShort.append(allCurve[0])
            curveLong.append(allCurve[1])
    else:
        return len_curveShort.append("None")

    return len_curveLong,len_curveShort

def getCurveShortLong(allCurve):
    len_curveShort = []
    len_curveLong = []
    curveShort = []
    curveLong = []
    if allCurve.Count == 4 :
        if allCurve[0].Length > allCurve[1].Length:
            len_curveShort.append(round(allCurve[1].Length))
            len_curveLong.append(round(allCurve[0].Length))
            curveShort.append(allCurve[1])
            curveLong.append(allCurve[0])
        else:
            len_curveShort.append(round(allCurve[0].Length))
            len_curveLong.append(round(allCurve[1].Length))
            curveShort.append(allCurve[0])
            curveLong.append(allCurve[1])
    else:
        return len_curveShort.append("None")

    return curveLong,curveShort

def GetSolids(cadInstance):
    opt = Options()
    allSolids = []
    geoElement = cadInstance.get_Geometry(opt)
    for geoObject in geoElement:
        geoInstance = geoObject.GetInstanceGeometry()
        for geoObject2 in geoInstance: 
            if geoObject2.GetType() == Solid and geoObject2.SurfaceArea > 0 :
               allSolids.append(geoObject2)
    return allSolids
def Dict(lst):
    s = []
    for i in lst:
       if i not in s:
          s.append(i)
    return s
def GetAllLayer(cadInstance):
    opt = Options()
    allLayer = []
    geoElement = cadInstance.get_Geometry(opt)
    for geoObject in geoElement:
        geoInstance = geoObject.GetInstanceGeometry()
        for geoObject2 in geoInstance: 
            if geoObject2.GetType() == Solid : 
                if geoObject2.SurfaceArea > 0 :
                   faceArray = geoObject2.Faces
                   for face in faceArray:
                       elementId = face.GraphicsStyleId
                       graphicsStyle = cadInstance.Document.GetElement(elementId)
                       styleCategory = graphicsStyle.GraphicsStyleCategory
                       allLayer.Add(styleCategory.Name)

            else:
                elementId = geoObject2.GraphicsStyleId
                graphicsStyle = cadInstance.Document.GetElement(elementId)
                styleCategory = graphicsStyle.GraphicsStyleCategory
                allLayer.Add(styleCategory.Name)
    allLayers = Dict(allLayer)
    allLayers.sort()
    return allLayers
def GetHatchLayerName(cadInstance,layerName):
    allHatch = []
    solids = GetSolids(cadInstance)
    if solids.Count == 0:
         return allHatch
    for solid in solids:
        for face in solid.Faces :
            graphicsStyle = cadInstance.Document.GetElement(face.GraphicsStyleId)
            if graphicsStyle == None :
                continue
            styleCategory = graphicsStyle.GraphicsStyleCategory
            if styleCategory.Name.Equals(layerName):
                allHatch.Add(face)
    return allHatch
def allCurves(planarFace):
    allCurves = []
    for edgeLoops in planarFace :
        edge_loops = edgeLoops.EdgeLoops
        for edgeArray in edge_loops:
            for edge in edgeArray:
        		allCurves.Add(edge.AsCurve())
    return allCurves
def allCurve(planarFace):
	allCurves = []
	edgeLoops = planarFace.EdgeLoops
	for edgeArray in edgeLoops:
		for edge in edgeArray:
			allCurves.Add(edge.AsCurve())
	return allCurve
def verticesColumn(planarFace):
    # for i in planarFace:
    vertices = planarFace.Triangulate().Vertices
    verticesColumn = (vertices[0].Add(vertices[2]))/2 
    return verticesColumn
def Angel(curveShort):
    direc_curveShort = curveShort.GetEndPoint(1).Subtract(curveShort.GetEndPoint(0)).Normalize()
    angle = XYZ.BasisX.AngleTo(direc_curveShort)
    return angle

cadInstance = UnwrapElement(IN[0])
layerName = IN[1]

allHatchs = GetHatchLayerName(cadInstance,layerName)
allCurve = allCurves(allHatchs)
#len_ShortLong = [getCurveShortLong(i) for i in allCurve]
vertice_Column = [verticesColumn(i) for i in allHatchs]
OUT = allHatchs,allCurve,vertice_Column

    

                   
# ----------------------------------------
code_block_10 = CodeBlock(a=python_script_3) { a[1]; }
python_script_4 = Python(IN[0]=code_block_10)
# ---------- python_script_4.python (46 lines) ----------
import sys
import clr
clr.AddReference('RevitServices')
import RevitServices
from RevitServices.Persistence import DocumentManager
from RevitServices.Transactions import TransactionManager
clr.AddReference('RevitNodes')
import Revit
clr.AddReference('ProtoGeometry')
from Autodesk.DesignScript.Geometry import *
clr.ImportExtensions(Revit.Elements)
clr.ImportExtensions(Revit.GeometryConversion)
clr.AddReference('RevitAPIUI')
from Autodesk.Revit.UI import *
from Autodesk.Revit.UI.Selection import *
clr.AddReference('RevitAPI')
from Autodesk.Revit.DB import * 
def lstFlatten(lst):
        result = []
        for i in lst:
        	for j in i :
                   result.append(j)
        return result
def getlen_CurveShortLong(allCurve):
    len_curveShort = []
    len_curveLong = []
    curveShort = []
    curveLong = []
    if allCurve.Count == 4 :
        if allCurve[0].Length > allCurve[1].Length:
            len_curveShort.append(round(allCurve[1].Length))
            len_curveLong.append(round(allCurve[0].Length))
            curveShort.append(allCurve[1])
            curveLong.append(allCurve[0])
        else:
            len_curveShort.append(round(allCurve[0].Length))
            len_curveLong.append(round(allCurve[1].Length))
            curveShort.append(allCurve[0])
            curveLong.append(allCurve[1])
            
    else:
        return len_curveShort.append("None")
    return len_curveLong,len_curveShort
allCurve = IN[0]
len_Curve = [getlen_CurveShortLong(i) for i in allCurve ]
OUT = len_Curve
# ----------------------------------------
list_create_3 = List.Create(item0=code_block_9.out0, item1=code_block_9.out1)
code_block_11 = CodeBlock { 0; }
round = Math.Round(number=list_create_3, digits=code_block_11)
floor = Math.Floor(number=round)
string_from_object = FromObject(obj=floor)
code_block_12 = CodeBlock(a=string_from_object) { a[0]; a[1]; }
code_block_13 = CodeBlock(b=code_block_12.out0, h=code_block_12.out1) { b+"x"+h+ "mm"; }
code_block_14 = CodeBlock(a=round) { a[0]; a[1]; }
code_block_15 = CodeBlock { "b"; "h"; }
duplicateFamilyInstance = Python(IN[0]=code_block.out2, IN[1]=code_block_14.out0, IN[2]=code_block_14.out1, IN[3]=code_block_15.out0, IN[4]=code_block_15.out1)
# ---------- duplicateFamilyInstance.python (50 lines) ----------
import sys
import clr
clr.AddReference('RevitServices')
import RevitServices
from RevitServices.Persistence import DocumentManager
from RevitServices.Transactions import TransactionManager
clr.AddReference('RevitNodes')
import Revit
clr.AddReference('ProtoGeometry')
from Autodesk.DesignScript.Geometry import *
clr.ImportExtensions(Revit.Elements)
clr.ImportExtensions(Revit.GeometryConversion)
clr.AddReference('RevitAPIUI')
from Autodesk.Revit.UI import *
from Autodesk.Revit.UI.Selection import *
clr.AddReference('RevitAPI')
from Autodesk.Revit.DB import * 
# import ngodinhcanh as ndc 
doc = DocumentManager.Instance.CurrentDBDocument 
view = doc.ActiveView
uidoc = DocumentManager.Instance.CurrentUIApplication.ActiveUIDocument 

def duplicateFamilyType(fa,b,h,b_para,h_para):
    newName = []
    bPara = []
    hPara = []
    for i,j in zip(b,h):
        bPara.append(i)
        hPara.append(j)
        newName.append((str(i)).replace(".0","")+" "+ "x" + " "+ (str(j)).replace(".0","")+"mm")
    TransactionManager.Instance.EnsureInTransaction(doc)
    familyType = []
    for name,i,j in zip(newName,bPara,hPara):
        try:
            a = fa[0].Duplicate(name)
            #a.LookupParameter(b_para).Set(i)
            #a.LookupParameter(h_para).Set(j)
            familyType.append(a)   
        except:
            "None"
        
    TransactionManager.Instance.TransactionTaskDone()
    return familyType
family = IN[0]
b = IN[1]
h = IN[2]
b_para = IN[3]
h_para = IN[4]
familyTypes = duplicateFamilyType(family,b,h,b_para,h_para)
OUT = familyTypes
# ----------------------------------------
createNewFamilyInstance = Python(IN[0]=code_block_10, IN[1]=code_block.out3, IN[2]=code_block.out4, IN[3]=duplicateFamilyInstance)
# ---------- createNewFamilyInstance.python (37 lines) ----------
import sys
import clr
clr.AddReference('RevitServices')
import RevitServices
from RevitServices.Persistence import DocumentManager
from RevitServices.Transactions import TransactionManager
clr.AddReference('RevitNodes')
import Revit
clr.AddReference('ProtoGeometry')
from Autodesk.DesignScript.Geometry import *
clr.ImportExtensions(Revit.Elements)
clr.ImportExtensions(Revit.GeometryConversion)
clr.AddReference('RevitAPIUI')
from Autodesk.Revit.UI import *
from Autodesk.Revit.UI.Selection import *
clr.AddReference('RevitAPI')
from Autodesk.Revit.DB import * 

doc = DocumentManager.Instance.CurrentDBDocument 
view = doc.ActiveView
uidoc = DocumentManager.Instance.CurrentUIApplication.ActiveUIDocument 
TamCot = IN[0]
familySymbol = IN[1]
BaseLevel = IN[2]
StructuralType = IN[3]

FamilyInstance = doc.Create.NewFamilyInstance(TamCot,familySymbol,BaseLevel, StructuralType)
FamilyInstance.get_Parameter(BuiltInParameter.FAMILY_BASE_LEVEL_PARAM).SetValue(BaseLevel.Id)
FamilyInstance.get_Parameter(BuiltInParameter.FAMILY_TOP_LEVEL_PARAM).Set(TopLevel.Id)
FamilyInstance.get_Parameter(BuiltInParameter.FAMILY_BASE_LEVEL_OFFSET_PARAM).Set(BaseOffset)
FamilyInstance.get_Parameter(BuiltInParameter.FAMILY_TOP_LEVEL_OFFSET_PARAM).Set(TopOffset)

# axis = Line.CreateUnbound(columnData.TamCot, XYZ.BasisZ)
# ElementTransformUtils.RotateElement(_viewModel.Doc,instance.Id, axis,columnData.GocXoay)

# newColumns.Add(instance.Id);
OUT = FamilyInstance
# ----------------------------------------
group_curves_2 = Custom[Group Curves](curves=code_block_10)
